# Grasshopper definition Sphere_with_random_pattern.gh (Grasshopper 1.0.7)

# ---- group: Dimensão em metros
number_slider = Slider(50, range=0..50)
number_slider_2 = Slider(30, range=0..50)

# ----
number_slider_3 = Slider(100, range=0..100)
xy_plane = XYPlane(Origin=Point(0, 0, 0))
subtraction = Subtraction(A=number_slider, B=number_slider_2)
# Ref.: https://www.youtube.com/watch?v=NWVq7SAe2zI&list=LL&index=129
number_slider_4 = Slider(10, range=0..10)
sphere = Sphere(Base=xy_plane, Radius=number_slider)
unit_z = UnitZ(Factor=subtraction)
circle = Circle(Plane=PlaneXY(0, 0, 0), Radius=number_slider_3)
move = Move(Geometry=sphere, Motion=unit_z)  # -> Geometry, Transform
negative = Negative(Value=Slider(70, range=0..100))
addition = Addition(A=number_slider_3, B=number_slider_4)
split_brep = SplitBrep(Brep=move.Geometry, Cutter=circle)
construct_point = ConstructPoint(XCoordinate=addition, YCoordinate=0, ZCoordinate=0)
construct_point_2 = ConstructPoint(XCoordinate=negative, YCoordinate=0, ZCoordinate=Slider(40, range=0..100))
list_item = ListItem(List=split_brep, Index=0, Wrap=True)
panel = Panel(split_brep)
line_sdl = LineSDL(Start=construct_point, Direction=construct_point_2, Length=Slider(200, range=0..200))
surface = Surface(list_item)
surface_curve = SurfaceCurve(Surface=surface, Curve=line_sdl)  # -> Curves, Points, UVPoints, Normals, Parameters, Tangents
construct_point_3 = ConstructPoint(XCoordinate=Slider(0, range=0..100), YCoordinate=Slider(0.94, range=0..5), ZCoordinate=0)
panel_2 = Panel(surface_curve.Tangents)
evaluate_surface = EvaluateSurface(Surface=reparameterize(surface), Point=construct_point_3)  # -> Point, Normal, UDirection, VDirection, Frame
evaluate_surface_2 = EvaluateSurface(Surface=reparameterize(surface), Point=surface_curve.UVPoints)  # -> Point, Normal, UDirection, VDirection, Frame
panel_3 = Panel(evaluate_surface.Normal)
circle_2 = Circle(Plane=evaluate_surface_2.Frame, Radius=Slider(20, range=0..20))
project = Project(Curve=circle_2, Brep=list_item, Direction=evaluate_surface.Normal)  # -> flatten(Curve)
surface_split = SurfaceSplit(Surface=surface, Curves=project)
radians = Radians(Degrees=Slider(100, range=0..100))
list_item_2 = ListItem(List=surface_split, Index=Slider(0, range=0..1), Wrap=True)
random = Random(Range=Slider(500, range=0..1000), Number=Slider(3, range=0..10), Seed=2)
number_slider_5 = Slider(160, range=0..1000)
random_2 = Random(Range=Domain(0, 1), Number=number_slider_5, Seed=random)  # -> simplify(Random)
random_3 = Random(Range=radians, Number=number_slider_5, Seed=2)
surface_2 = Surface(list_item_2)
populate_geometry = PopulateGeometry(Geometry=surface_2, Count=number_slider_5, Seed=1)
surface_closest_point = SurfaceClosestPoint(Point=populate_geometry, Surface=surface_2)  # -> Point, UVPoint, Distance
evaluate_surface_3 = EvaluateSurface(Surface=surface_2, Point=surface_closest_point.UVPoint)  # -> Point, Normal, UDirection, VDirection, Frame
explode_tree = ExplodeTree(Data=random_2)  # -> Branch0, Branch1, Branch2
vector_xyz = VectorXYZ(XComponent=explode_tree.Branch0, YComponent=explode_tree.Branch1, ZComponent=explode_tree.Branch2)  # -> Vector, Length
rotate_3d = Rotate3D(Geometry=evaluate_surface_3.Frame, Angle=random_3, Center=evaluate_surface_3.Frame, Axis=vector_xyz.Vector)  # -> Geometry, Transform
brep_edges = BrepEdges(Brep=surface_2)  # -> Naked, Interior, NonManifold
brep_plane = BrepPlane(Brep=surface_2, Plane=rotate_3d.Geometry)  # -> Curves, Points
curve = Curve(brep_edges.Naked)
pipe = Pipe(Curve=curve, Radius=Slider(0.05, range=0..0.1), Caps=Slider(2, range=0..10))
pipe_2 = Pipe(Curve=brep_plane.Curves, Radius=Slider(0.2, range=0.02..0.5), Caps=Slider(2, range=0..10))
merge = Merge(Data1=pipe)
